# Grasshopper definition grasshopper_to_place_cone.gh (Grasshopper 1.0.8)

pt = Point(Point(0, 0, 0))
brep = Brep(<brep referenced from the Rhino model>)
pt_2 = Point(Point(2409.247621, 1159.851361, 1369.105749))
cluster = Cluster(
    relay_2=Slider(406.4, range=0..1000),
    Y=Slider(2679.7, range=0..5000),
    N=Slider(200, range=0..1000),
    C=Slider(5, range=1..50),
    relay_3=Slider(150, range=0..5000),
    B_2=Slider(157, range=-1000..1000),
    G=brep,
    A=pt,
    relay=Slider(80, range=0..1000),
    B=pt_2)  # -> L, out_cone_centroid_bottoms, out_cones, out_rectangle
panel = Panel(cluster.L)

# ==== cluster Cluster
relay = ClusterInput()
relay_2 = ClusterInput()
relay_3 = ClusterInput()
A = ClusterInput()
B = ClusterInput()
N = ClusterInput()
C = ClusterInput()
B_2 = ClusterInput()
Y = ClusterInput()
vec2pt = Vector2Pt(PointA=A, PointB=B, Unitize=False)  # -> Vector, Length
series = Series(Start=0, Step=N, Count=C)
pt = ConstructPoint(XCoordinate=relay, YCoordinate=relay_3, ZCoordinate=0)
subtraction = Subtraction(A=relay_2, B=relay)
addition = Addition(A=relay_3, B=B_2)
rectangle = Rectangle(Plane=PlaneXY(0, 0, 0), XSize=relay_2, YSize=Y, Radius=0)  # -> Rectangle, Length
pt_2 = ConstructPoint(XCoordinate=subtraction, YCoordinate=addition, ZCoordinate=0)
Y_2 = UnitY(Factor=series)
move = Move(Geometry=rectangle.Rectangle, Motion=vec2pt.Vector)  # -> Geometry, Transform
merge = Merge(Data1=pt, Data2=pt_2)
move_2 = Move(Geometry=graft(merge), Motion=Y_2)  # -> Geometry, Transform
G = ClusterInput()
move_3 = Move(Geometry=move_2.Geometry, Motion=vec2pt.Vector)  # -> Geometry, Transform
move_4 = Move(Geometry=G, Motion=move_3.Geometry)  # -> Geometry, Transform
lng = ListLength(List=flatten(move_4.Geometry))
L = ClusterOutput(lng)
out_rectangle = ClusterOutput(move.Geometry)
out_cone_centroid_bottoms = ClusterOutput(move_3.Geometry)
out_cones = ClusterOutput(move_4.Geometry)
